# Grasshopper definition generate_geom.gh (Grasshopper 1.0.7)
# plug-ins: Human, MetaHopper

python = GhPythonScript(on=Button(), y="compas_assembly")  # -> out, a
# ---------- python: Python ----------
from compas_ghpython.utilities import unload_modules

if on:
    unload_modules(y)
# ---------- end python ----------

subtraction = Subtraction(A="37500", B=1)
selobj = GetSelectedObjects(AllObjects_Object=number_slider_3)  # -> ComponentObjects, ParamObjects, OtherObjects
subtraction_2 = Subtraction(A="37500", B=1)
dom = ConstructDomain(DomainStart="35000", DomainEnd=subtraction)
selobj_2 = GetSelectedObjects(AllObjects_Object=number_slider)  # -> ComponentObjects, ParamObjects, OtherObjects
dom_2 = ConstructDomain(DomainStart="35000", DomainEnd=subtraction_2)
set_slider = SetSliderProperties(Slider=selobj.ParamObjects, Range=dom)
set_slider_2 = SetSliderProperties(Slider=selobj_2.ParamObjects, Range=dom_2)

# ----
# QUERY
toggle = BooleanToggle(False)
panel = Panel("test")
python_2 = GhPythonScript(on=toggle, folder="analysis", name="train", num_start="35000", num_end="37500")  # -> out, label; inputs num_start: Int32, num_end: Int32
# ---------- python_2: Python ----------
import os
from compas_assembly.datastructures import Assembly
from compas_assembly.rhino import AssemblyArtist

import rhinoscriptsyntax as rs
import Rhino
import scriptcontext as sc

import json

sc.doc = Rhino.RhinoDoc.ActiveDoc

file_name = ghenv.Component.OnPingDocument().FilePath
FOLDER1 = os.path.dirname(file_name)
FOLDER2 = folder

label = []
max_resultant = []

if not on:
    print("IT'S OFF")
else:
    print("IT'S ON")
    for i in range(num_start,num_end):
        NAME = name + str(i) + "_done.json"
        FILE = os.path.join(FOLDER1,FOLDER2,NAME)
        
        print(FILE)
        
        # ==============================================================================
        # Load assembly from file
        # ==============================================================================
        
        assembly = Assembly.from_json(FILE)
        
        tension = 0
        resultants = []
        
        for (a, b), attr in assembly.edges(True):
            #print("Interface", (a,b))
            if attr['interface_forces'] is None:
                continue
            
            R = 0
            for i in range(len(attr['interface_points'])):
                sp = attr['interface_points'][i]
                c = attr['interface_forces'][i]['c_np']
                t = attr['interface_forces'][i]['c_nn']
                f = c - t
                if f > 0.0:
                    R += f
                else:
                    R += f
                    tension = 1
                    
            resultants.append(R)
            
        label.append(tension)
        max_resultant.append(max(resultants))
        
        
    print(label)
    print(max_resultant)
    
    sc.doc = ghdoc
# ---------- end python_2 ----------
# 1. SET TOWER TYPE INTO ANALYSIS .JSON GENERATOR
# 2. MAKE SURE TEST OR TRAIN IS SET
# 3. SET THE RANGE TO GENERATE
# 4. ANIMATE THE SLIDER (WILL SAVE IMAGE AND ASSEMBLY ANALYSIS SCRIPT)
# 5. RENAME THE IMAGE FILES
# 6. SOLVE THE ASSEMBLY SCRIPTS (RUN _BATCH FROM CMDLINE)
# 7. QUERY SOLUTIONS AND MOVE IMAGES INTO CORRECT FOLDER.
panel_2 = Panel(python_2.out)

# ----
# MOVE
panel_3 = Panel("train")
python_3 = GhPythonScript(
    on=Toggle(False),
    label=python_2.label,
    folder1="images",
    folder2=panel_3,
    name="Frame_",
    num_start="35000",
    num_end="37500")  # -> out, label; inputs label: list of Int32, num_start: Int32, num_end: Int32
# ---------- python_3: Python ----------
import os
from compas_assembly.datastructures import Assembly
from compas_assembly.rhino import AssemblyArtist

import rhinoscriptsyntax as rs
import Rhino
import scriptcontext as sc

import json
import shutil

sc.doc = Rhino.RhinoDoc.ActiveDoc

file_name = ghenv.Component.OnPingDocument().FilePath
FOLDER = os.path.dirname(file_name)
FOLDER1 = folder1
FOLDER2 = folder2

img_folder = os.path.join(FOLDER,FOLDER1,FOLDER2)
print("IMAGE FOLDER", img_folder)

if not on:
    print("IT'S OFF")
else:
    for i in range(num_start,num_end):
        ii = str(i)
        
        NAME = name + ii.zfill(5) + ".bmp"
        FILE_FROM = os.path.join(img_folder,NAME)
        
        if label[i-num_start] > 0:
            TO = "unstable"
        else:
            TO = "stable"
        
        FILE_TO = os.path.join(img_folder,TO,NAME)
        
        FILE_FROM = FILE_FROM.replace(os.sep, '/')
        FILE_TO = FILE_TO.replace(os.sep, '/')
        
        shutil.move(FILE_FROM, FILE_TO)
# ---------- end python_3 ----------
panel_5 = Panel(python_3.out)

# ----
# RENAME
toggle_2 = BooleanToggle(False)
python_4 = GhPythonScript(on=toggle_2, folder1="images", folder2="train", name="Frame_", num_start="35000", num_end="37500")  # -> out, label; inputs num_start: Int32, num_end: Int32
# ---------- python_4: Python ----------
import os
from compas_assembly.datastructures import Assembly
from compas_assembly.rhino import AssemblyArtist

import rhinoscriptsyntax as rs
import Rhino
import scriptcontext as sc

import json
import shutil

sc.doc = Rhino.RhinoDoc.ActiveDoc

file_name = ghenv.Component.OnPingDocument().FilePath
FOLDER = os.path.dirname(file_name)
FOLDER1 = folder1
FOLDER2 = folder2

img_folder = os.path.join(FOLDER,FOLDER1,FOLDER2)
print("IMAGE FOLDER", img_folder)

#all the image paths in the "image folder"
img_paths = [os.path.join(img_folder,f) for f in os.listdir(img_folder)]
img_paths = [f for f in img_paths if os.path.isfile(f)]

#split all the files down to just the suffix number (remove 0's) 
img_name_nums = [ (os.path.splitext(os.path.split(i)[1])[0].split(name)[1].lstrip("0")) for i in img_paths]

#Deal with edge case where the image name is 'Frame_00000.bmp'
img_name_nums = ["0" if x == '' else x for x in img_name_nums]

#Only select the images that fall within the range
#This is to avoid selecting images that have already been adjusted
old_nums = [int(x) for x in img_name_nums if int(x) not in range(num_start,num_end) ]

#The new name is a shift by the starting count for this set
new_nums = [x+num_start for x in old_nums]

if not on:
    print("IT'S OFF")
else:
    for old,new in zip(old_nums,new_nums):
        old = str(old)
        new = str(new)
        
        name_from = name + old.zfill(5) + ".bmp"
        FILE_FROM = os.path.join(img_folder,name_from)
        
        name_to = name + new.zfill(5) + ".bmp"
        FILE_TO = os.path.join(img_folder,name_to)
        
        print(name_from, "TO", name_to)
        
        FILE_FROM = FILE_FROM.replace(os.sep, '/')
        FILE_TO = FILE_TO.replace(os.sep, '/')
        
        shutil.move(FILE_FROM, FILE_TO)

"""
if not on:
    print("IT'S OFF")
else:
    for i,img_path in zip(range(num_start,num_end),img_paths):
        ii = str(i)
        
        
        FILE_FROM = img_path
        
        print(ii, FILE_FROM)
        
        NAME = name + ii.zfill(5) + ".bmp"
        FILE_TO = os.path.join(img_folder,'renamed',NAME)
        print(FILE_TO)
        
        FILE_FROM = FILE_FROM.replace(os.sep, '/')
        FILE_TO = FILE_TO.replace(os.sep, '/')
        
        shutil.move(FILE_FROM, FILE_TO)
"""
# ---------- end python_4 ----------
panel_6 = Panel(python_4.out)

# ----
# TRAPEZOID
# TOWER
# Always animate 1 less than you want. If you want 10, animate 9.
# 
# Do not click away from the screen during this process
W = Slider(2.4, range=1..8)
W_2 = Slider(5.4, range=1..8)
W_3 = Slider(0.5, range=0..4)
W_4 = Slider(1, range=0..4)
W_5 = Slider(2.5, range=0..4)
W_6 = Slider(1, range=0..4)
dom_3 = ConstructDomain(DomainStart=W, DomainEnd=W_2)
dom_4 = ConstructDomain(DomainStart=W_3, DomainEnd=W_5)
dom_5 = ConstructDomain(DomainStart=W_6, DomainEnd=W_4)
num = Slider(7, range=1..20)
number_slider = Slider(35000, range=35000..37499)
python_5 = GhPythonScript(W=dom_3, H=dom_4, D=dom_5)  # -> block
# ---------- python_5: Python ----------
import rhinoscriptsyntax as rs
import Rhino as rc

import random

class new_block:
    
    range_H = H
    range_W = W
    range_D = D
    
    d = D[0]
    h = 0
    w = 0
    
    num = 0
    name = "none"
    pnt_bot = []
    pnt_top = []
    
    center = rs.CreatePoint(0,0,0)
    vec = []
    surf = []
    brep = []
    
    
    def init(self,i):
        self.num = i
        self.name = "block" + str(i)
        self.pnt_bot = []
        self.pnt_top = []
        self.surf = []
        self.brep = []
        
        self.center = rs.CreatePoint(0,0,0)
        
        self.h = random.uniform(self.range_H[0],self.range_H[1] )
        self.w = random.uniform(self.range_W[0],self.range_W[1] )
        
        end = [random.uniform(-1,1),0,random.uniform(0.6,1)]
        self.vec = rs.VectorCreate(end, [0,0,0])
        self.vec = rs.VectorUnitize(self.vec)*self.h
        
    
    def create_block(self,tower):
        
        if not self.num:
            print("first block")
        else:
            print("block #",self.num+1)
            self.find_bottom_plane(tower)
            
        self.create_points()
        self.create_surface()
        self.extrude_surface()

    def find_bottom_plane(self,tower):
        print("--find bottom plane")
        a = tower[self.num-1].pnt_top
        
        x_sum = 0
        y_sum = 0
        z_sum = 0
        for i in range(len(a)):
            x_sum += a[i].X
            y_sum += a[i].Y
            z_sum += a[i].Z
            
        self.center[0] = x_sum/len(a)
        self.center[1] = y_sum/len(a)
        self.center[2] = z_sum/len(a)

        
    def create_points(self):
        print("--create face")
        
        x = self.center[0]
        y = self.center[1]
        z = self.center[2]
        
        self.pnt_bot.append(rs.CreatePoint(x-self.w/2, y-self.d/2, z))
        self.pnt_bot.append(rs.CreatePoint(x-self.w/2, y+self.d/2, z))
        self.pnt_bot.append(rs.CreatePoint(x+self.w/2, y+self.d/2, z))
        self.pnt_bot.append(rs.CreatePoint(x+self.w/2, y-self.d/2, z))
        
        for i in range(4):
            self.pnt_top.append(rs.coerce3dpoint(rs.CopyObject(self.pnt_bot[i], self.vec)))
            
    def create_surface(self):
        print("--create surface")
        self.surf = rs.AddSrfPt(self.pnt_bot)
        
    def extrude_surface(self):
        print("--create brep")
        
        e = rs.CopyObject(self.center, self.vec)
        
        n_line = rs.AddLine(self.center,e)
        
        self.brep = rs.ExtrudeSurface(self.surf, n_line)
        
        

block = new_block()
# ---------- end python_5 ----------
python_6 = GhPythonScript(a=python_5, seed=number_slider, num_bricks=num)  # -> out, tower, brep_list; inputs num_bricks: Int32
# ---------- python_6: Python ----------
__author__ = "edvardbruun"
__version__ = "2020.05.05"

import rhinoscriptsyntax as rs
import scriptcontext as sc
import copy
import random
import time

sc.doc = ghdoc

random.seed(seed)
time.sleep(0.2)
tower = []

for i in range(num_bricks):
    print("NEW BLOCK")
    block = copy.deepcopy(a)
    
    block.init(i)
    block.create_block(tower)
    
    tower.append(block)

brep_list = []
for i in range(num_bricks):
    brep_list.append(tower[i].brep)

"""
print(tower[0].name)
print(tower[0].range_W)
print(tower[0].pnt_bot)
print(tower[0].pnt_top)
print(tower[0].surf)
print(tower[0].brep)
"""
# ---------- end python_6 ----------
brep = Brep(python_6.brep_list)
panel_8 = Panel(python_6.out)
python_7 = GhPythonScript(x=brep)  # -> out, meshes, brepMesh; inputs x: Brep
# ---------- python_7: Python ----------
import Rhino
from Rhino.Geometry import *
from Rhino.Input import RhinoGet
from Rhino.Commands import Result
from Rhino.DocObjects import ObjectType
import rhinoscriptsyntax as rs
from scriptcontext import doc

jaggedAndFaster = MeshingParameters.Coarse

meshes = Mesh.CreateFromBrep(x,jaggedAndFaster)
print(meshes)

brepMesh = Mesh()
for mesh in meshes:
    brepMesh.Append(mesh)
    
print(brepMesh)
# ---------- end python_7 ----------
mesh = Mesh(python_7.brepMesh)
weld = WeldMesh(Mesh=mesh, Angle=3.141592654)
python_8 = GhPythonScript(mesh=weld)  # -> vol, compas_block
# ---------- python_8: Python ----------
from compas.datastructures import Mesh
from compas_assembly.datastructures import Block

compas_block = Block.from_rhinomesh(mesh)
compas_block.attributes['name'] = "EB_test"
print(compas_block.attributes)

vol = compas_block.volume()
# ---------- end python_8 ----------
ma = MassAddition(Input=python_8.vol)  # -> Result, PartialResults
panel_9 = Panel(ma.Result)
panel_10 = Panel(python_8.vol)

H = Slider(1.7, range=0..4)

# ----
# BASE BLOCK
number_slider_2 = Slider(10, range=1..10)
python_9 = GhPythonScript(dim=number_slider_2, thick=Slider(1, range=1..5))  # -> out, ground
# ---------- python_9: Python ----------
import rhinoscriptsyntax as rs

l = dim
t = thick

pnt = []
pnt.append(rs.AddPoint(-l,-l, -t))
pnt.append(rs.AddPoint(-l, l, -t))
pnt.append(rs.AddPoint(l, l, -t))
pnt.append(rs.AddPoint(l, -l, -t))

b = rs.AddSrfPt(pnt)

startPoint = [0, 0, 0]
endPoint = [0, 0, t]
line1 = [startPoint, endPoint]
line = rs.AddLine(line1[0],line1[1])


ground = (rs.ExtrudeSurface(b, line))
# ---------- end python_9 ----------
brep_2 = Brep(python_9.ground)
preview = CustomPreview(Geometry=brep_2, Material=ColourSwatch(SwatchColor=RGB(56, 56, 56)))
python_10 = GhPythonScript(x=brep_2)  # -> out, meshes, brepMesh; inputs x: Brep; same code as python_7
mesh_2 = Mesh(python_10.brepMesh)
weld_2 = WeldMesh(Mesh=mesh_2, Angle=3.141592654)
python_11 = GhPythonScript(mesh=weld_2)  # -> compas_block
# ---------- python_11: Python ----------
from compas.datastructures import Mesh
from compas_assembly.datastructures import Block

compas_block = Block.from_rhinomesh(mesh)
compas_block.attributes['name'] = "EB_Support_Block"
print(compas_block.attributes)
# ---------- end python_11 ----------

number_slider_3 = Slider(35000, range=35000..37499)

# ----
# RECTANGLE
# TOWER
W_7 = Slider(4, range=1..8)
D = Slider(1, range=1..8)
python_12 = GhPythonScript(W=W_7, H=H, D=D)  # -> block
# ---------- python_12: Python ----------
import rhinoscriptsyntax as rs
import Rhino as rc

import random

######################
# block dimensions
W = W
H = H
D = D

pnt = []
pnt.append(rs.AddPoint(-W/2, -D/2, -H/2))
pnt.append(rs.AddPoint(-W/2, D/2, -H/2))
pnt.append(rs.AddPoint(W/2, D/2, -H/2))
pnt.append(rs.AddPoint(W/2, -D/2, -H/2))

b = rs.AddSrfPt(pnt)

startPoint = [0, 0, 0]
endPoint = [0, 0, H]
line1 = [startPoint, endPoint]
line = rs.AddLine(line1[0],line1[1])

block = rs.ExtrudeSurface(b, line)
############
print(block)
# ---------- end python_12 ----------
num_2 = Slider(6, range=1..8)
python_13 = GhPythonScript(block=python_12, seed=number_slider_3, H=H, num_bricks=num_2, factor=Slider(1.3, range=0..2))  # -> tower; inputs num_bricks: Int32
# ---------- python_13: Python ----------
import rhinoscriptsyntax as rs
import scriptcontext as sc
import Rhino as rc

import random

sc.doc = ghdoc

f = factor

random.seed(seed)

tower = []
for i in range(num_bricks):
    
    x = f*random.uniform(-f,f) # slide over in x-direction
    vec = rs.VectorCreate([x,0,H/2 + i*H],[0,0,0])
    
    b = rs.CopyObject(block)
    tower.append(rs.MoveObject(b,vec))
# ---------- end python_13 ----------
brep_3 = Brep(python_13)
python_14 = GhPythonScript(x=brep_3)  # -> out, meshes, brepMesh; inputs x: Brep; same code as python_7
mesh_3 = Mesh(python_14.brepMesh)
weld_3 = WeldMesh(Mesh=mesh_3, Angle=3.141592654)
python_15 = GhPythonScript(mesh=weld_3)  # -> vol, compas_block; same code as python_8
ma_2 = MassAddition(Input=python_15.vol)  # -> Result, PartialResults
panel_11 = Panel(ma_2.Result)
panel_12 = Panel(python_15.vol)

number_slider_4 = Slider(1, range=0..10)
merge = Merge(Data1=weld_2, Data2=weld)

# ----
# MAKE
# .JSON FILE
toggle_3 = BooleanToggle(False)
python_16 = GhPythonScript(
    execute=toggle_3,
    folder="analysis",
    name="train",
    num=number_slider,
    base=python_11,
    y2=python_8.compas_block,
    y3=python_15.compas_block)  # -> out; inputs num: Int32, y2: list, y3: list
# ---------- python_16: Python ----------
import os
import sys
import random
from math import pi
from random import choice
from compas.geometry import Box
from compas.geometry import Translation
from compas.geometry import Rotation
from compas.geometry import scale_vector
from compas_assembly.datastructures import Assembly
from compas_assembly.datastructures import Block


y = y2

# ==============================================================================
# Assembly
# ==============================================================================

assembly = Assembly()

assembly.add_block(base)
for block in y:
    assembly.add_block(block)

assembly.summary()

# mark the bottom block as support
assembly.node_attribute(0, 'is_support', True)

# ==============================================================================
# Export
# ==============================================================================

if execute:
    
    file_name = ghenv.Component.OnPingDocument().FilePath
    FOLDER1 = os.path.dirname(file_name)
    FOLDER2 = folder

    NAME = name + str(num) + ".json"
    FILE = os.path.join(FOLDER1,FOLDER2,NAME)
    print(FILE)
    
    assembly.to_json(FILE)
# ---------- end python_16 ----------
panel_13 = Panel(python_16)

# ----
# VISUALIZE
mesh_4 = Mesh(flatten(merge))
mjoin = MeshJoin(Meshes=mesh_4)  # -> flatten(Mesh)
preview_2 = CustomPreview(Geometry=mesh_4, Material=ColourSwatch(SwatchColor=RGBA(56, 56, 56, 25)))
medges = MeshEdges(Mesh=mjoin)  # -> NakedEdges, InteriorEdges, NonManifoldEdges
python_17 = GhPythonScript(z=mjoin)  # -> mesh
# ---------- python_17: Python ----------
from compas.datastructures import Mesh
from compas_assembly.datastructures import Block

print(z)

mesh = Block.from_rhinomesh(z)
mesh.attributes['name'] = "EB_displaymesh"
print(mesh.attributes)
# ---------- end python_17 ----------
python_18 = GhPythonScript(mesh=python_17)  # -> m, v, e
# ---------- python_18: Python ----------
from compas_ghpython.artists import MeshArtist


artist = MeshArtist(mesh)
m = artist.draw_mesh()
v = artist.draw_vertices()
e = artist.draw_edges()
# ---------- end python_18 ----------
previewlw = CustomPreviewLineweights(
    Geometry=[medges.InteriorEdges, medges.NakedEdges, medges.NonManifoldEdges],
    Shader=ColourSwatch(SwatchColor=RGB(0, 0, 0)),
    Thickness=Slider(6, range=1..10),
    Absolute=False)

# ----
# COMPLEX
number_slider_5 = Slider(17, range=0..20)
button = Button()
xz = XZPlane(Origin=Point(0, 0, 0))
python_19 = GhPythonScript(u=Toggle(True), seed=number_slider_5, y=xz)  # -> out, block; inputs y: Plane
# ---------- python_19: Python ----------
import rhinoscriptsyntax as rs
import Rhino.Geometry as rg
import Rhino
import scriptcontext as sc

import compas.geometry as compas
from compas.datastructures import Mesh

from compas_rhino.artists import MeshArtist

from compas_assembly.datastructures import Assembly
from compas_assembly.datastructures import Block

import random

sc.doc = ghdoc

x_max = 3
y_max = -0.5
z_max = 4

num_p = 4
random.seed(seed)

test = 4
for i in range(test):
    print(random.random())

if u:
    pnt = []
    pnt2 = []
    for i in range (num_p):
        if i == 0:
            x = random.uniform(-x_max,0)
            y = random.uniform(y_max,y_max)
            z = random.uniform(-1,0)
        elif i == 1:
            x = random.uniform(0,x_max)
            y = random.uniform(y_max,y_max)
            z = random.uniform(-1,0)
        else:
            x = random.uniform(-x_max,x_max)
            y = random.uniform(y_max,y_max)
            z = random.uniform(0,z_max)
        
        pnt.append(rs.AddPoint(x, y, z))
        
    b = rs.AddSrfPt(pnt)
    
    startPoint = [0, 0, 0]
    endPoint = [0, 1, 0]
    line1 = [startPoint, endPoint]
    l = rs.AddLine(line1[0],line1[1])
    
    block = []
    block.append(rs.ExtrudeSurface(b, l))
# ---------- end python_19 ----------

brep_4 = Brep(python_9.ground)
brep_5 = Brep(python_19.block)
python_20 = GhPythonScript(x=brep_4, y=brep_5)  # -> out, b
# ---------- python_20: Python ----------
import rhinoscriptsyntax as rs
import Rhino.Geometry as rg
import scriptcontext as sc

tol=sc.doc.ModelAbsoluteTolerance

print(tol)
#a = rg.Brep.CreateBooleanDifference(x,y)

solid0 = rs.coercebrep(x)
solid1 = rs.coercebrep(y)

#b = rg.Brep.CreateBooleanDifference(solid1, solid0, tol) 
b = rg.Brep.CreateBooleanSplit(solid1, solid0, tol) 
print(len(b))
# ---------- end python_20 ----------
item = ListItem(List=python_20.b, Index=Slider(1, range=0..5), Wrap=True)

python_21 = GhPythonScript(x=item)  # -> out, a
# ---------- python_21: Python ----------
import rhinoscriptsyntax as rs
import Rhino as rc

import random


random.seed(2)

print(x)
vec = rs.VectorCreate([-2,0,0],[0,0,0])

b = rs.CopyObject(x)
a = rs.MoveObject(b,vec)
# ---------- end python_21 ----------
python_22 = GhPythonScript(x=python_21.a, y=item)  # -> out, b; same code as python_20
item_2 = ListItem(List=python_22.b, Index=Slider(1, range=0..5), Wrap=True)
brep_6 = Brep(flatten([item_2, python_21.a]))
python_23 = GhPythonScript(x=brep_6)  # -> out, meshes, brepMesh; inputs x: Brep
# ---------- python_23: Python ----------
import Rhino
from Rhino.Geometry import *
from Rhino.Input import RhinoGet
from Rhino.Commands import Result
from Rhino.DocObjects import ObjectType
import rhinoscriptsyntax as rs
from scriptcontext import doc

jaggedAndFaster = MeshingParameters.Coarse
#jaggedAndFaster = MeshingParameters.Default
print(jaggedAndFaster)

meshes = Mesh.CreateFromBrep(x,jaggedAndFaster)
print(meshes)

brepMesh = Mesh()
for mesh in meshes:
    brepMesh.Append(mesh)
    
print(brepMesh)
# ---------- end python_23 ----------
smesh = SimpleMesh(Brep=brep_6)
mesh_5 = Mesh(smesh)
weld_4 = WeldMesh(Mesh=mesh_5, Angle=3.141592654)
python_24 = GhPythonScript(mesh=weld_4)  # -> vol, compas_block
# ---------- python_24: Python ----------
from compas.datastructures import Mesh
from compas_assembly.datastructures import Block

compas_block = Block.from_rhinomesh(mesh)
compas_block.attributes['name'] = "EB_test"
print(compas_block.attributes)


vol = compas_block.volume()
# ---------- end python_24 ----------
panel_15 = Panel(python_24.vol)

item_3 = ListItem(List=weld_4, Index=number_slider_4, Wrap=True)
item_4 = ListItem(List=python_24.compas_block, Index=number_slider_4, Wrap=True)
python_25 = GhPythonScript(x=item_4)  # -> out, a
# ---------- python_25: Python ----------
for i in range (len(x.vertex)):
    print(x.vertex[i]['x'], x.vertex[i]['y'], x.vertex[i]['z'])
# ---------- end python_25 ----------
demesh = DeconstructMesh(Mesh=item_3)  # -> Vertices, Faces, Colours, Normals
panel_16 = Panel(python_25.out)
panel_17 = Panel(demesh.Vertices)
item_5 = ListItem(List=weld_3, Index=0, Wrap=True)
item_6 = ListItem(List=python_15.compas_block, Index=0, Wrap=True)
python_26 = GhPythonScript(x=item_6)  # -> out, a; same code as python_25
demesh_2 = DeconstructMesh(Mesh=item_5)  # -> Vertices, Faces, Colours, Normals
panel_18 = Panel(demesh_2.Vertices)
panel_19 = Panel(python_26.out)
item_7 = ListItem(List=weld, Index=0, Wrap=True)
item_8 = ListItem(List=python_8.compas_block, Index=0, Wrap=True)
python_27 = GhPythonScript(x=item_8)  # -> out, a; same code as python_25
demesh_3 = DeconstructMesh(Mesh=item_7)  # -> Vertices, Faces, Colours, Normals
panel_20 = Panel(demesh_3.Vertices)
panel_21 = Panel(python_27.out)
item_9 = ListItem(List=weld_2, Index=0, Wrap=True)
item_10 = ListItem(List=python_11, Index=0, Wrap=True)
python_28 = GhPythonScript(x=item_10)  # -> out, a; same code as python_25
demesh_4 = DeconstructMesh(Mesh=item_9)  # -> Vertices, Faces, Colours, Normals
panel_22 = Panel(demesh_4.Vertices)
panel_23 = Panel(python_28.out)
